% Simulink data dictionary UAM_data.sldd

SensorAAFiltNum = 4386000
SensorAAFiltDen = [1 2960 4386000]

flightState = enum(DefaultValue="Hover")
  Hover = 0
  Transition = 1
  FixedWing = 2
  BackTransition = 3

FSState = flightState.Hover
R_WAYPOINTTRANSITION = 1
R_LOOKAHEAD = 5
control = struct(L1=30, cruiseSpeed=15, turningRadius=50, takeoffNavAlt=20, minThrottle=0.1, maxThrottle=1)

AAC = Simulink.Bus()
  airspeed: double
  altitude: double
  course: double
  L1: double
  climbrate: double

FWControl = struct(transitionRadius=10)
HoverMission = struct(mode=uint8(0), position=[0; 0; 0], params=[0; 0; 0; 0])
UAVSampleTime = 0.02
Vt = 10
zGround = 0

FixedWingCommandBus = Simulink.Bus()
  roll: double
  pitch: double
  yaw: double
  airspeed: double

controlMode = Simulink.Bus()
  lateralGuidance: uint8
  airspeedAltitude: uint8
  attitude: uint8
  manual: uint8
  armed: uint8
  inTransition: uint8
  TransitionCondition: uint8

HoverSPBus = Simulink.Bus()
  X: double
  Y: double
  Z: double
  Yaw: double

innerLoopCmdsBus = Simulink.Bus()
  LAP: double[3 1]
  HeadingCmd: double
  YawCmd: double

UAVPathManagerBus = Simulink.Bus()
  mode: uint8
  position: double[3 1]
  params: double[4 1]

doubleUavPathManager = Simulink.Bus()
  mode: uint8
  position: double[3 1]
  params: double[4 1]

TransitionMission = [struct(mode=1, position=[0; 0; 0], params=[0; 0; 0; 0]), struct(mode=2, position=[0; 0; -20], params=[0; 0; 0; 0]), struct(mode=2, position=[20; 0; -20], params=[0; 0; 0; 0]), struct(mode=6, position=[1; 1; 1], params=[1; 1; 1; 1]), struct(mode=2, position=[100; 0; -20], params=[0; 0; 0; 0]), struct(mode=3, position=[100; 200; -20], params=[50; -1; 0.5; 0]), struct(mode=6, position=[-1; -1; -1], params=[-1; -1; -1; -1]), struct(mode=2, position=[300; 300; -20], params=[0; 0; 0; 0]), struct(mode=4, position=[300; 300; 0], params=[0; 0; 0; 0])]
guidanceType = 3

FlightModeType = enum(DefaultValue="Manual")
  Manual = 0
  Auto = 1
  Emergency = 2

RC = Simulink.Bus()
  roll: double
  pitch: double
  yaw: double
  throttle: double
  trigger: double

RotorParameters = Simulink.Bus()
  w1: double
  w2: double
  w3: double
  w4: double
  c1: double

sensorData = Simulink.Bus()
  GPSCourse: double
  gndspeed: double
  DiffPress: double
  rho: double
  LLA: double[1 3]
  Abb: double[1 3]
  Gyro: double[1 3]
  Mag: double[1 3]
  GPSVelocity: double[1 3]
  Abe: double[1 3]
  RotorParameter: Bus: RotorParameters
  RC: Bus: RC

StateBus = Simulink.Bus()
  course: double
  gndspeed: double
  airspeed: double
  Xe: double[3 1]
  Ve: double[3 1]
  DCMbe: double[3 3]
  q: double[1 4]
  pqr: double[3 1]
  Vb: double[1 3]
  Abb: double[1 3]
  Abe: double[1 3]
  Euler: double[3 1]
  RotorParameter: Bus: RotorParameters
  ypr: double[3 1]
  Ve_ground: double[3 1]
  RC: Bus: RC

GuidanceStates = Simulink.Bus()
  Euler: double[3]
  pqr: double[3]
  Ve: double[3]
  Xe: double[3]
  course: double
  RotorParameter: Bus: RotorParameters